# Dynamo graph LeonardoSole_TrabalhoFinal.dyn (Dynamo 2.5.0.7460)
# packages: Clockwork for Dynamo 2.x 2.3.0, GenerativeDesign 1.3.1, GenerativeDesign.Revit 1.3.1

# group: Selecionar ambiente
selecionar_quarto = DSModelRoomSelection()  # 1 picked in the model
selecionar_porta = DSModelFamilyInstanceSelection()  # 1 picked in the model

# group: Quarto
finishes = Custom[Room.Finishes](room=selecionar_quarto)  # package Clockwork for Dynamo 2.x; Returns all room bounding faces and their materials
geometry = Element.Geometry(element=finishes.elements)
flatten = List.Flatten(list=geometry)
remember = Data.Remember(flatten)
byUnion = Solid.ByUnion(solids=remember)
coreBoundary = Room.CoreBoundary(room=selecionar_quarto)
remember_2 = Data.Remember(coreBoundary)
flatten_2 = List.Flatten(list=coreBoundary)
remember_3 = Data.Remember(flatten_2)
length = Curve.Length(curve=remember_3)
code_block = CodeBlock(l=length) { h = Math.Sqrt(l[0]*l[0]+l[1]*l[1]); }
byJoinedCurves = PolyCurve.ByJoinedCurves(curves=remember_2)
remember_4 = Data.Remember(byJoinedCurves)
byPatch = Surface.ByPatch(closedCurve=remember_4)
code_block_2 = CodeBlock { Color.ByARGB(255, 150, 150, 150); }
byGeometryColor = Modifiers.GeometryColor.ByGeometryColor(geometry=byPatch, color=code_block_2)

# group: INPUTS
IN_U3 = DoubleSlider(1, range=0..1 step 0.25)  # graph input
IN_V3 = DoubleSlider(1, range=0..1 step 0.25)  # graph input
IN_Degree3 = DoubleSlider(0, range=0..1 step 1)  # graph input
IN_U2 = DoubleSlider(0, range=0..1 step 0.25)  # graph input
IN_V2 = DoubleSlider(0.75, range=0..1 step 0.25)  # graph input
IN_Degree2 = DoubleSlider(1, range=0..1 step 1)  # graph input
IN_U1 = DoubleSlider(1, range=0..1 step 0.25)  # graph input
IN_V1 = DoubleSlider(0, range=0..1 step 0.25)  # graph input
IN_Degree1 = DoubleSlider(1, range=0..1 step 1)  # graph input

# group: Selecionar móveis
selecionar_comoda = DSModelFamilyInstanceSelection()  # 1 picked in the model
selecionar_cama = DSModelFamilyInstanceSelection()  # 1 picked in the model

# group: Cômoda 2
getLocation = Element.GetLocation(element=selecionar_comoda)
remember_5 = Data.Remember(getLocation)
geometry_2 = Element.Geometry(element=selecionar_comoda)
remember_6 = Data.Remember(geometry_2)
byUnion_2 = Solid.ByUnion(solids=remember_6)

adicionarMovel = Custom[AdicionarMovel](parede=byUnion, profundidade=IN_U3, posicao=IN_V3, start=remember_5, geometry=byUnion_2, rot=IN_Degree3, curvas=remember_2)

# group (continued): Cômoda 2
byUnion_3 = Solid.ByUnion(solids=adicionarMovel.Área_Livre)
byUnion_4 = Solid.ByUnion(solids=adicionarMovel.Área_Física)
list_create = List.Create(item0=byUnion_3, item1=byUnion_4)
byUnion_5 = Solid.ByUnion(solids=list_create)
code_block_3 = CodeBlock(exibir=adicionarMovel.AF_Cor) { exibir; }
code_block_4 = CodeBlock(exibir=adicionarMovel.AL_Cor) { exibir; }

# group: Cômoda 1
getLocation_2 = Element.GetLocation(element=selecionar_comoda)
remember_7 = Data.Remember(getLocation_2)
geometry_3 = Element.Geometry(element=selecionar_comoda)
remember_8 = Data.Remember(geometry_3)
byUnion_6 = Solid.ByUnion(solids=remember_8)

adicionarMovel_2 = Custom[AdicionarMovel](parede=byUnion, profundidade=IN_U2, posicao=IN_V2, start=remember_7, geometry=byUnion_6, rot=IN_Degree2, curvas=remember_2)

# group (continued): Cômoda 1
byUnion_7 = Solid.ByUnion(solids=adicionarMovel_2.Área_Livre)
byUnion_8 = Solid.ByUnion(solids=adicionarMovel_2.Área_Física)
list_create_2 = List.Create(item0=byUnion_7, item1=byUnion_8)
byUnion_9 = Solid.ByUnion(solids=list_create_2)
code_block_5 = CodeBlock(exibir=adicionarMovel_2.AF_Cor) { exibir; }
code_block_6 = CodeBlock(exibir=adicionarMovel_2.AL_Cor) { exibir; }

# group: Cama
getLocation_3 = Element.GetLocation(element=selecionar_cama)
remember_9 = Data.Remember(getLocation_3)
geometry_4 = Element.Geometry(element=selecionar_cama)
remember_10 = Data.Remember(geometry_4)
byUnion_10 = Solid.ByUnion(solids=remember_10)
adicionarMovel_3 = Custom[AdicionarMovel](parede=byUnion, profundidade=IN_U1, posicao=IN_V1, start=remember_9, geometry=byUnion_10, rot=IN_Degree1, curvas=remember_2)
byUnion_11 = Solid.ByUnion(solids=adicionarMovel_3.Área_Livre)
byUnion_12 = Solid.ByUnion(solids=adicionarMovel_3.Área_Física)
list_create_3 = List.Create(item0=byUnion_11, item1=byUnion_12)
byUnion_13 = Solid.ByUnion(solids=list_create_3)
code_block_7 = CodeBlock(exibir=adicionarMovel_3.AF_Cor) { exibir; }
code_block_8 = CodeBlock(exibir=adicionarMovel_3.AL_Cor) { exibir; }

# group: Listas de móveis
ATs = List.Create(item0=byUnion_5, item1=byUnion_9, item2=byUnion_13)
AFs = List.Create(item0=byUnion_4, item1=byUnion_8, item2=byUnion_12)
ALs = List.Create(item0=byUnion_3, item1=byUnion_7, item2=byUnion_11)

# group: Porta
geometry_5 = Element.Geometry(element=selecionar_porta)
string = StringInput("Solid")
removeIfNot = List.RemoveIfNot(list=geometry_5, type=string)
remember_11 = Data.Remember(removeIfNot)
code_block_9 = CodeBlock(x=remember_11) { List.Slice(x,0,1); x[0]; }
boundingBox = Geometry.BoundingBox(geometry=code_block_9.out1)
byUnion_14 = Solid.ByUnion(solids=remember_11)
boundingBox_2 = Geometry.BoundingBox(geometry=byUnion_14)
getLocation_4 = Element.GetLocation(element=selecionar_porta)
remember_12 = Data.Remember(getLocation_4)
byOrigin = CoordinateSystem.ByOrigin(origin=remember_12)
code_block_10 = CodeBlock(bbox=boundingBox, pbbox=boundingBox_2, o=byOrigin)
# ---------- code_block_10.designscript (12 lines) ----------
dX = Math.Abs(bbox.MaxPoint.X - bbox.MinPoint.X);
dY = Math.Abs(bbox.MaxPoint.Y - bbox.MinPoint.Y);
h = Math.Abs(bbox.MaxPoint.Z - bbox.MinPoint.Z);
pX = Math.Abs(pbbox.MaxPoint.X - pbbox.MinPoint.X);
pY = Math.Abs(pbbox.MaxPoint.Y - pbbox.MinPoint.Y);
pg = dX>dY?dY/2:dX/2;
lado = dX>dY?dX:dY;
parede = pX>pY?pY/2:pX/2;
tY = dX>dY?lado/2+parede-pg:0;
tX = dX>dY?0:lado/2+parede-pg;
or = CoordinateSystem.Translate(o,tX,tY,0);
Rectangle.ByWidthLength(or,lado,lado);
# ----------------------------------------
extrudeAsSolid = Curve.ExtrudeAsSolid(curve=code_block_10.out11, distance=code_block_10.h)
byUnion_15 = Solid.ByUnion(solids=code_block_9.out0)
code_block_11 = CodeBlock { color1 = Color.ByARGB(160, 120, 65, 14); color2 = Color.ByARGB(30, 255, 100, 100); }
byGeometryColor_2 = Modifiers.GeometryColor.ByGeometryColor(geometry=byUnion_15, color=code_block_11.color1)
byGeometryColor_3 = Modifiers.GeometryColor.ByGeometryColor(geometry=extrudeAsSolid, color=code_block_11.color2)

# group: Interseções ÁREAS TOTAIS
count = List.Count(list=ATs)
doesIntersect = Geometry.DoesIntersect(geometry=ATs, other=ATs, lacing=CrossProduct)
countTrue = List.CountTrue(list=doesIntersect)
eq = count == countTrue
byUnion_16 = Solid.ByUnion(solids=ATs)
list_create_4 = List.Create(item0=byUnion, item1=extrudeAsSolid)
byUnion_17 = Solid.ByUnion(solids=list_create_4)
doesIntersect_2 = Geometry.DoesIntersect(geometry=byUnion_16, other=byUnion_17)
# note: Interseções de áreas zeram as pontuações.
countFalse = List.CountFalse(list=doesIntersect_2)

# group: Distâncias base
Q_moveis = List.Count(list=AFs)
code_block_12 = CodeBlock(h=code_block, q_moveis=Q_moveis) { limite_porta = h/q_moveis; limite_moveis = limite_porta/2; }

# group: Distância porta
distanceTo = Geometry.DistanceTo(geometry=extrudeAsSolid, other=AFs)
gt = distanceTo > code_block_12.limite_porta  # lacing=CrossProduct
flatten_3 = List.Flatten(list=gt)
# note: Quantidade de móveis distantes da porta.
countTrue_2 = List.CountTrue(list=flatten_3)

# group: Distância parede
distanceTo_2 = Geometry.DistanceTo(geometry=byUnion, other=AFs)
code_block_13 = CodeBlock { limite_parede = 0.02; }
le = distanceTo_2 <= code_block_13
# note: Quantidade de móveis encostados nas paredes.
countTrue_3 = List.CountTrue(list=le)

# group: Distância entre móveis
distanceTo_3 = Geometry.DistanceTo(geometry=AFs, other=AFs, lacing=CrossProduct)
flatten_4 = List.Flatten(list=distanceTo_3)
sort = List.Sort(list=flatten_4)
count_2 = List.Count(list=AFs)
dropItems = List.DropItems(list=sort, amount=count_2)
code_block_14 = CodeBlock { 2; }
dropEveryNthItem = List.DropEveryNthItem(list=dropItems, n=code_block_14)
gt_2 = dropEveryNthItem > code_block_12.limite_moveis  # lacing=CrossProduct
flatten_5 = List.Flatten(list=gt_2)
# note: Quantidade de móveis distantes um do outro.
countTrue_4 = List.CountTrue(list=flatten_5)

# group: Avaliação
AF = CodeBlock(al=eq, paredes=countFalse)
# ---------- AF.designscript (3 lines) ----------
// intersecao de areas fisicas zera pontuacao
area_livre = al?1:0;
area_livre*paredes;
# ----------------------------------------
avaliacao = CodeBlock(grave=AF.out1, porta=countTrue_2, parede=countTrue_3, moveis=countTrue_4)
# ---------- avaliacao.designscript (4 lines) ----------
dist_porta = grave*porta*porta;
dist_parede = grave*parede*parede;
pontuacao_quarto = (dist_porta+dist_parede)/2;
dist_moveis = grave*moveis*moveis;
# ----------------------------------------
OUT_Quarto = Watch(avaliacao.pontuacao_quarto)  # graph output
OUT_Moveis = Watch(avaliacao.dist_moveis)  # graph output
