# Dynamo custom node Add_Movel.dyf (Dynamo 2.5.0.7460)
# category: Aulas_Sistemas
# adiciona um movel
# packages: Clockwork for Dynamo 2.x 2.3.0

curve = Input(curve: Autodesk.DesignScript.Geometry.Curve)
geometry = Input(geometry: var)
boundingBox = Geometry.BoundingBox(geometry=geometry)
properties = Custom[BoundingBox.Properties](boundingBox=boundingBox)  # package Clockwork for Dynamo 2.x; Retrieves the centroid, width, depth and height of a given bounding box
code_block = CodeBlock(w=properties.Width, d=properties.Depth) { offset = w>d?-d/2:-w/2; }
offset = Curve.Offset(curve=curve, distance=code_block)
byPatch = Surface.ByPatch(closedCurve=offset)
u = Input(u: double)
v = Input(v: double)
pointAtParameter = Surface.PointAtParameter(surface=byPatch, u=u, v=v)
Location = Output(pointAtParameter)
code_block_2 = CodeBlock(p=pointAtParameter, d=properties.Depth, w=properties.Width, h=properties.Height)
# ---------- code_block_2.designscript (8 lines) ----------
// Area livre da cama: 60cm p/ frente
o = CoordinateSystem.ByOrigin(p);
or = CoordinateSystem.Translate(o,0,-d/2-0.3,0);

al = Rectangle.ByWidthLength(or,w,0.6);
af = Rectangle.ByWidthLength(o,w,d);
h;
Vector.ZAxis();
# ----------------------------------------
extrudeAsSolid = Curve.ExtrudeAsSolid(curve=code_block_2.al, distance=code_block_2.h)
x = Input(x: var[]..[])
code_block_3 = CodeBlock(x=x) { 360/8*x; }
rotate = Geometry.Rotate(geometry=extrudeAsSolid, origin=pointAtParameter, axis=code_block_2.out5, degrees=code_block_3)
AL = Output(rotate)
extrudeAsSolid_2 = Curve.ExtrudeAsSolid(curve=code_block_2.af, distance=code_block_2.h)
rotate_2 = Geometry.Rotate(geometry=extrudeAsSolid_2, origin=pointAtParameter, axis=code_block_2.out5, degrees=code_block_3)
AF = Output(rotate_2)
code_block_4 = CodeBlock { 50; 255; }
byARGB = Color.ByARGB(a=code_block_4.out0, r=code_block_4.out1, g=code_block_4.out0, b=code_block_4.out0)
byGeometryColor = Modifiers.GeometryColor.ByGeometryColor(geometry=rotate, color=byARGB)
GeometryColor = Output(byGeometryColor)
Rotation = Output(code_block_3)
