# Dynamo graph Trabalho.dyn (Dynamo 2.5.0.7460)
# packages: Clockwork for Dynamo 2.x 2.3.0, GenerativeDesign 1.3.1, GenerativeDesign.Revit 1.3.1

selecionar_comodo = DSModelRoomSelection()  # 1 picked in the model
coreBoundary = Room.CoreBoundary(room=selecionar_comodo)
byJoinedCurves = PolyCurve.ByJoinedCurves(curves=coreBoundary)
remember = Data.Remember(byJoinedCurves)
code_block = CodeBlock { 3; }
extrudeAsSolid = Curve.ExtrudeAsSolid(curve=remember, distance=code_block)
remember_2 = Data.Remember(extrudeAsSolid)
IN_U2 = DoubleSlider(0.04, range=0..1 step 0.01)  # graph input
IN_V2 = DoubleSlider(0, range=0..1 step 0.01)  # graph input
selecionar_comoda = DSModelFamilyInstanceSelection()  # 1 picked in the model
IN_Degree2 = DoubleSlider(0, range=0..7 step 1)  # graph input
geometry = Element.Geometry(element=selecionar_comoda)
byUnion = Solid.ByUnion(solids=geometry)
remember_3 = Data.Remember(byUnion)
add_Movel = Custom[Add_Movel](u=IN_U2, v=IN_V2, element=selecionar_comoda, curve=byJoinedCurves, x=IN_Degree2, geometry=remember_3)  # adiciona um movel
IN_U1 = DoubleSlider(0.64, range=0..1 step 0.01)  # graph input
IN_V1 = DoubleSlider(0.52, range=0..1 step 0.01)  # graph input
selecionar_cama = DSModelFamilyInstanceSelection()  # 1 picked in the model
IN_Degree1 = DoubleSlider(0, range=0..7 step 1)  # graph input
geometry_2 = Element.Geometry(element=selecionar_cama)
byUnion_2 = Solid.ByUnion(solids=geometry_2)
remember_4 = Data.Remember(byUnion_2)
add_Movel_2 = Custom[Add_Movel](u=IN_U1, v=IN_V1, element=selecionar_cama, curve=byJoinedCurves, x=IN_Degree1, geometry=remember_4)

# group: Testes AL-AF
difference = Solid.Difference(solid=remember_2, other=add_Movel.AF)
intersect = Geometry.Intersect(geometry=difference, other=add_Movel_2.AL)
volume = Solid.Volume(solid=intersect)
difference_2 = Solid.Difference(solid=remember_2, other=add_Movel_2.AF)
intersect_2 = Geometry.Intersect(geometry=difference_2, other=add_Movel.AL)
volume_2 = Solid.Volume(solid=intersect_2)

volume_3 = Solid.Volume(solid=add_Movel_2.AF)
volume_4 = Solid.Volume(solid=add_Movel.AF)
code_block_2 = CodeBlock(e=selecionar_comodo) { n = "Perimeter"; p = Elements.Element.GetParameterValueByName(e, n); p/4; }
remember_5 = Data.Remember(code_block_2.out2)
finishes = Custom[Room.Finishes](room=selecionar_comodo)  # package Clockwork for Dynamo 2.x; Returns all room bounding faces and their materials
geometry_3 = Element.Geometry(element=finishes.elements)
remember_6 = Data.Remember(geometry_3)

# group: Porta
selecionar_porta = DSModelFamilyInstanceSelection()  # 1 picked in the model
geometry_4 = Custom[Element.Geometry+](element=selecionar_porta)  # package Clockwork for Dynamo 2.x; Returns Dynamo AND native Revit geometry of a given element
byUnion_3 = Custom[Solid.ByUnion+](solids=geometry_4.dynamoGeometry)  # package Clockwork for Dynamo 2.x; The OOTB node Solid.ByUnion occasionally fails when trying to merge solids with almost adjacent faces. This node will return the minimum amount of joined solids possible in such cases instead of returning null.
getLocation = Element.GetLocation(element=selecionar_porta)
byOrigin = CoordinateSystem.ByOrigin(origin=getLocation)

code_block_3 = CodeBlock(x=geometry_4.dynamoGeometry) { x[0]; }

# group (continued): Porta
boundingBox = Geometry.BoundingBox(geometry=code_block_3)

boundingBox_2 = Geometry.BoundingBox(geometry=byUnion_3)

# group (continued): Porta
code_block_4 = CodeBlock(bbox=boundingBox, pbbox=boundingBox_2, o=byOrigin)
# ---------- code_block_4.designscript (12 lines) ----------
dX = Math.Abs(bbox.MaxPoint.X - bbox.MinPoint.X);
dY = Math.Abs(bbox.MaxPoint.Y - bbox.MinPoint.Y);
h = Math.Abs(bbox.MaxPoint.Z - bbox.MinPoint.Z);
pX = Math.Abs(pbbox.MaxPoint.X - pbbox.MinPoint.X);
pY = Math.Abs(pbbox.MaxPoint.Y - pbbox.MinPoint.Y);
pg = dX>dY?dY/2:dX/2;
lado = dX>dY?dX:dY;
parede = pX>pY?pY/2:pX/2;
tY = dX>dY?lado/2+parede-pg:0;
tX = dX>dY?0:lado/2+parede-pg;
or = CoordinateSystem.Translate(o,tX,tY,0);
Rectangle.ByWidthLength(or,lado,lado);
# ----------------------------------------
extrudeAsSolid_2 = Curve.ExtrudeAsSolid(curve=code_block_4.out11, distance=code_block_4.h)
remember_7 = Data.Remember(extrudeAsSolid_2)

# group: Testes AF
code_block_5 = CodeBlock(paredes=remember_6, porta=remember_7)
# ---------- code_block_5.designscript (3 lines) ----------
// Criar solido unico com paredes + area da porta
solidos = List.Flatten([paredes, porta]);
uniao = Solid.ByUnion(solidos);
# ----------------------------------------
doesIntersect = Geometry.DoesIntersect(geometry=add_Movel.AF, other=add_Movel_2.AF)
countFalse = List.CountFalse(list=doesIntersect)
code_block_6 = CodeBlock(t1=add_Movel_2.AF, t2=add_Movel.AF) { ts = [t1, t2]; Solid.ByUnion(t1); }
doesIntersect_2 = Geometry.DoesIntersect(geometry=code_block_5.uniao, other=code_block_6.out1)
countFalse_2 = List.CountFalse(list=doesIntersect_2)
code_block_7 = CodeBlock(moveis=countFalse, paredes=countFalse_2) { moveis*paredes; }

distanceTo = Geometry.DistanceTo(geometry=add_Movel_2.AF, other=code_block_5.uniao)
code_block_8 = CodeBlock(s2=volume, s1=volume_3, s4=volume_2, s3=volume_4, p=remember_5, d=distanceTo, grave=code_block_7)
# ---------- code_block_8.designscript (4 lines) ----------
frac1 = List.Flatten(s2,10)[0]/s1[0];
frac2 = List.Flatten(s4,10)[0]/s3[0];
fracd = (p-d[0])/p;
(frac1+frac2+fracd)*grave;
# ----------------------------------------
watch = Watch(code_block_8.frac1)  # graph output
byPatch = Surface.ByPatch(closedCurve=remember)
code_block_9 = CodeBlock(rect=code_block_4.out11) { rect; }
remember_8 = Data.Remember(code_block_9)
code_block_10 = CodeBlock(d=distanceTo) { d[0]; }
